# Dynamo graph Building Blocks of Programs - Math.dyn (Dynamo 3.6.0.9395)

# group: 
# Descrição <Clique duas vezes aqui para editar a descrição do grupo>
XY = Plane.XY()
code_block = CodeBlock { 0..360..#100; }
rotate = Geometry.Rotate(basePlane=XY, degrees=code_block, lacing=CrossProduct)  # unwired: geometry

# group: 
# Descrição <Clique duas vezes aqui para editar a descrição do grupo>
number = DoubleInput(0.01)
number_slider = DoubleSlider(104.3, range=0..149 step 0.1)
number_2 = DoubleInput(0.1)
sequence = Sequence(start=number, amount=number_slider, step=number_2, lacing=Longest)

# group: 
# Descrição <Clique duas vezes aqui para editar a descrição do grupo>
radiansToDegrees = Math.RadiansToDegrees(radians=sequence)
cos = Math.Cos(angle=radiansToDegrees)
E = Math.E()
number_slider_2 = DoubleSlider(0.282, range=0..1 step 0.001)
mul = sequence * number_slider_2
pow = Math.Pow(number=E, power=mul)
number_slider_3 = DoubleSlider(0.852, range=0..1 step 0.001)
mul_2 = pow * number_slider_3
mul_3 = cos * mul_2
sin = Math.Sin(angle=radiansToDegrees)
mul_4 = sin * mul_2

# group: 
# Descrição <Clique duas vezes aqui para editar a descrição do grupo>
byCoordinates = Point.ByCoordinates(x=mul_3, y=mul_4)

# group: 
# Descrição <Clique duas vezes aqui para editar a descrição do grupo>
byPoints = PolyCurve.ByPoints(points=byCoordinates)

# group: 
# Descrição <Clique duas vezes aqui para editar a descrição do grupo>
byCenterPointRadius = Circle.ByCenterPointRadius(centerPoint=byCoordinates, radius=sequence)

XY_2 = Plane.XY()
number_3 = DoubleInput(0)
number_4 = DoubleInput(360)
number_5 = DoubleInput(3.6)
range = Range(start=number_3, end=number_4, step=number_5, lacing=Longest)
rotate_2 = Geometry.Rotate(geometry=byCoordinates, basePlane=XY_2, degrees=range, lacing=CrossProduct)
