# Dynamo graph View Grids by Point.dyn (Dynamo 3.6.0.9395)
# packages: Clockwork for Dynamo 3.x 3.3.0

# group: Título <Clique duas vezes aqui para editar o título do grupo>
# Descrição <Clique duas vezes aqui para editar a descrição do grupo>
views = Views("Nível 1")  # graph input
coordenada_x = DoubleInput(20)  # graph input
coordenada_y = DoubleInput(20)  # graph input
tamanho_y = DoubleSlider(20, range=0..1000 step 10)  # graph input
numero_de_linhas_y = DoubleSlider(5, range=0..100 step 1)  # graph input
tamanho_x = DoubleSlider(20, range=0..1000 step 10)  # graph input
numero_de_linhas_x = DoubleSlider(5, range=0..100 step 1)  # graph input

# group: texto Y esquerda
# Descrição <Clique duas vezes aqui para editar a descrição do grupo>
y_points = CodeBlock(coordY=coordenada_y, tamanhoY=tamanho_y, numDiv=numero_de_linhas_y) { coordY..coordY + tamanhoY..#numDiv; }
watch = Watch(y_points)
byCoordinates = Point.ByCoordinates(x=coordenada_x, y=watch)
watch_2 = Watch(byCoordinates)
code_block = CodeBlock(y=watch) { "Y: "+ y; }
select_vertical_text_alignment = VerticalAlignment()  # nothing selected
number = DoubleInput(-90)
byLocation = TextNote.ByLocation(view=views, location=watch_2, text=code_block, alignment=select_vertical_text_alignment, rotation=number)
watch_3 = Watch(byLocation)
byCoordinates_2 = Point.ByCoordinates(x=coordenada_x, y=watch)
watch_4 = Watch(byCoordinates_2)

# group: texto Y direita
# Descrição <Clique duas vezes aqui para editar a descrição do grupo>
code_block_2 = CodeBlock(x=coordenada_x, tamanho=tamanho_x) { x+tamanho; }
y_points_2 = CodeBlock(coordY=coordenada_y, tamanhoY=tamanho_y, numDiv=numero_de_linhas_y) { coordY..coordY + tamanhoY..#numDiv; }
watch_5 = Watch(y_points_2)
byCoordinates_3 = Point.ByCoordinates(x=code_block_2, y=watch_5)
watch_6 = Watch(byCoordinates_3)
code_block_3 = CodeBlock(y=watch_5) { y+1.5; }
byCoordinates_4 = Point.ByCoordinates(x=code_block_2, y=code_block_3)
code_block_4 = CodeBlock(y=watch_5) { "Y: "+ y; }
select_vertical_text_alignment_2 = VerticalAlignment()  # nothing selected
number_2 = DoubleInput(-90)
byLocation_2 = TextNote.ByLocation(view=views, location=byCoordinates_4, text=code_block_4, alignment=select_vertical_text_alignment_2, rotation=number_2)
watch_7 = Watch(byLocation_2)

# group: texto X inferior
# Descrição <Clique duas vezes aqui para editar a descrição do grupo>
y_points_3 = CodeBlock(coordX=coordenada_x, tamanhoX=tamanho_x, numdivX=numero_de_linhas_x) { coordX..coordX + tamanhoX..#numdivX; }
watch_8 = Watch(y_points_3)
code_block_5 = CodeBlock(y=coordenada_y) { y; y-0.2; }
byCoordinates_5 = Point.ByCoordinates(x=watch_8, y=code_block_5.y)
watch_9 = Watch(byCoordinates_5)
code_block_6 = CodeBlock(x=watch_8) { x+1.2; }
byCoordinates_6 = Point.ByCoordinates(x=code_block_6, y=code_block_5.out1)
code_block_7 = CodeBlock(x=watch_8) { "X : "+ x; }
select_vertical_text_alignment_3 = VerticalAlignment()  # nothing selected
byLocation_3 = TextNote.ByLocation(view=views, location=byCoordinates_6, text=code_block_7, alignment=select_vertical_text_alignment_3)
watch_10 = Watch(byLocation_3)

# group: texto X superior
# Descrição <Clique duas vezes aqui para editar a descrição do grupo>
y_points_4 = CodeBlock(coordX=coordenada_x, tamanhoX=tamanho_x, numdivX=numero_de_linhas_x) { coordX..coordX + tamanhoX..#numdivX; }
watch_11 = Watch(y_points_4)
code_block_8 = CodeBlock(y=coordenada_y, tamanhoy=tamanho_y) { y+tamanhoy; y+tamanhoy+0.5; }
byCoordinates_7 = Point.ByCoordinates(x=watch_11, y=code_block_8.out0)
watch_12 = Watch(byCoordinates_7)
code_block_9 = CodeBlock(x=watch_11) { x+1.2; }
byCoordinates_8 = Point.ByCoordinates(x=code_block_9, y=code_block_8.out1)
code_block_10 = CodeBlock(x=watch_11) { "X : "+ x; }
select_vertical_text_alignment_4 = VerticalAlignment()  # nothing selected
byLocation_4 = TextNote.ByLocation(view=views, location=byCoordinates_8, text=code_block_10, alignment=select_vertical_text_alignment_4)
watch_13 = Watch(byLocation_4)

byStartPointEndPoint = Line.ByStartPointEndPoint(startPoint=byCoordinates_5, endPoint=byCoordinates_7)
views_2 = Views("Nível 1")  # graph input
byCurve = Custom[DetailCurve.ByCurve+](curve=byStartPointEndPoint, view=views_2)  # package Clockwork for Dynamo 3.x; Creates a detail line based on a given curve. Unlike the OOTB node it can also draw circles.
byStartPointEndPoint_2 = Line.ByStartPointEndPoint(startPoint=watch_4, endPoint=byCoordinates_3)
byCurve_2 = Custom[DetailCurve.ByCurve+](curve=byStartPointEndPoint_2, view=views_2)
