# Dynamo graph find coordinate.dyn (Dynamo 3.6.0.9395)

# group: Selecionar Vàrios Objetos
# lembre de desativar as anotações da vista, selecione somente objetos
select_model_elements = DSModelElementsSelection()  # 2 picked in the model
longitude_ew = DoubleInput(23.55)
PI = Math.PI()
div = longitude_ew / PI
boundingBox = Element.BoundingBox(element=select_model_elements)
minPoint = BoundingBox.MinPoint(boundingBox=boundingBox)
maxPoint = BoundingBox.MaxPoint(boundingBox=boundingBox)
code_block = CodeBlock(min=minPoint, max=maxPoint) { min.X + (max.X- min.X)/2; min.Y + (max.Y- min.Y)/2; min.Z + (max.Z - min.Z)/2; }
raio_da_terra = DoubleInput(6378137)
div_2 = code_block.out0 / raio_da_terra
mul = div * div_2
latitude_ns = DoubleInput(23.588)
code_block_2 = CodeBlock(latitude=latitude_ns, meters=code_block.out1) { latitude + (meters *180/(Math.PI*6378197)); }
byCoordinates = Point.ByCoordinates(x=mul, y=code_block_2, z=code_block.out2)
code_block_3 = CodeBlock(p=byCoordinates) { ["EW Manual", "NS Manual"]; [p.X , p.Y]; }
setParameterByName = Element.SetParameterByName(element=select_model_elements@L2, parameterName=code_block_3.out0@L1, value=code_block_3.out1@L2, lacing=Longest)
watch = Watch(minPoint)
watch_2 = Watch(maxPoint)
watch_3 = Watch(select_model_elements)
watch_4 = Watch(code_block_2)
