# Dynamo graph find coordinates.dyn (Dynamo 3.6.0.9395)

select_model_element = DSModelElementSelection()  # 1 picked in the model
getLocation = Element.GetLocation(element=select_model_element)
watch = Watch(getLocation)
minPoint = BoundingBox.MinPoint(boundingBox=select_model_element)
watch_2 = Watch(minPoint)
maxPoint = BoundingBox.MaxPoint()  # unwired: boundingBox
watch_3 = Watch(maxPoint)
code_block = CodeBlock(min=minPoint, max=maxPoint) { min.X + (max.X- min.X)/2; min.Y + (max.Y- min.Y)/2; }
byCoordinates = Point.ByCoordinates(x=code_block.out0, y=code_block.out1)
