# Dynamo graph scope box.dyn (Dynamo 3.6.0.9395)

pick_model_elements = DSModelElementMultipleSelection()  # 82 picked in the model
geometry = Element.Geometry(element=pick_model_elements)
flatten = List.Flatten(list=geometry)
byMinimumVolume = BoundingBox.ByMinimumVolume(geom=flatten)
byLevel = FloorPlanView.ByLevel(level=byMinimumVolume)
