# Dynamo graph script para escrever posicionamento SIRGAS.dyn (Dynamo 3.6.0.9395)

# group: Selecionar Vàrios Objetos
# lembre de desativar as anotações da vista, selecione somente objetos
select_model_elements = DSModelElementsSelection()  # 6 picked in the model; graph input
boundingBox = Element.BoundingBox(element=select_model_elements)
minPoint = BoundingBox.MinPoint(boundingBox=boundingBox)
maxPoint = BoundingBox.MaxPoint(boundingBox=boundingBox)
code_block = CodeBlock(min=minPoint, max=maxPoint) { min.X + (max.X- min.X)/2; min.Y + (max.Y- min.Y)/2; }
byCoordinates = Point.ByCoordinates(x=code_block.out0, y=code_block.out1)
code_block_2 = CodeBlock(p=byCoordinates) { ["Localização Georreferenciada"]; ["SIRGAS2000 / UTM23S – X: "+ p.X + ", Y: "+ p.Y]; }
setParameterByName = Element.SetParameterByName(element=select_model_elements@L2, parameterName=code_block_2.out0@L1, value=code_block_2.out1@L2, lacing=Longest)
watch = Watch(minPoint)
watch_2 = Watch(maxPoint)
watch_3 = Watch(select_model_elements)
code_block_3 = CodeBlock {  }
watch_4 = Watch(code_block_2.out1)  # graph output
